# Grasshopper definition rir_ dune 1 bed.gh (Grasshopper 1.0.7)
# plug-ins: Rhino.Inside for Autodesk Revit, EleFront, Pufferfish

# ---- group: stuff
authornames = CSharpScript(SetNameToWindowsName=Button(), ResetName=Button())  # -> out; inputs SetNameToWindowsName: Boolean, ResetName: Boolean
# ---------- authornames: C# ----------
    if(SetNameToWindowsName)
    {
      if (string.Equals(Grasshopper.CentralSettings.AuthorName, Environment.UserName, StringComparison.InvariantCulture))
      {

        msg = "Didn't change author name, as it was already set to " + Environment.UserName;
      }
      else
      {
        oldName = Grasshopper.CentralSettings.AuthorName;
        Grasshopper.CentralSettings.AuthorName = Environment.UserName;
        msg = "Changed author name to " + Environment.UserName + "\nThe old name was " + oldName;
      }
    }

    if (ResetName && !String.IsNullOrEmpty(oldName))
    {
      Grasshopper.CentralSettings.AuthorName = oldName;
      msg = "Reset author name to " + oldName;
    }

    Print(msg);
# ---------- authornames: C# additional code ----------
  string oldName = string.Empty;
  string msg = string.Empty;
# ---------- end authornames ----------
panel = Panel(authornames)

# ---- group: grid
# rafter
# door
linear_grid = ValueList({"constructCrv", "constructCrv::Layer 01", "constructCrv::Layer 03", "Default", "i_geometry", "i_geometry::grid", "i_geometry::grid::arcGrid", "i_geometry::grid::linearGrid", "i_geometry::roofCrv", "i_revit", "i_revit::door", "i_revit::door::BlockLine", "i_revit::door::dim", "i_revit::door::DoorGeo", "i_revit::floor", "i_revit::floor::bath", "i_revit::floor::living", "i_revit::floor::mep", "i_revit::floor::pool", "i_revit::floor::terrace", "i_revit::floor::wc", "i_revit::wall", "i_revit::wall::curtain", "i_revit::wall::ext wall", "i_revit::wall::int wall", "site", "site::pool", "site::roof3d", "site::sand"}, selected="i_geometry::grid::linearGrid")
arc_grid = ValueList({"Default", "guildCrv", "guildCrv::Layer 01", "i_geometry", "i_geometry::grid", "i_geometry::grid::arcGrid", "i_geometry::roofCrv", "i_revit", "i_revit::curtain", "i_revit::ext wall", "i_revit::floor", "i_revit::int wall", "site", "site::pool", "site::roof3d", "site::sand"}, selected="i_geometry::grid::arcGrid")
grid = ValueList({"constructCrv", "constructCrv::Layer 01", "constructCrv::Layer 03", "Default", "i_geometry", "i_geometry::grid", "i_geometry::grid::arcGrid", "i_geometry::grid::linearGrid", "i_geometry::roofCrv", "i_revit", "i_revit::door", "i_revit::door::BlockLine", "i_revit::door::dim", "i_revit::door::DoorGeo", "i_revit::floor", "i_revit::floor::bath", "i_revit::floor::living", "i_revit::floor::mep", "i_revit::floor::pool", "i_revit::floor::terrace", "i_revit::floor::wc", "i_revit::wall", "i_revit::wall::curtain", "i_revit::wall::ext wall", "i_revit::wall::int wall", "site", "site::pool", "site::roof3d", "site::sand"}, selected="i_geometry::grid::linearGrid")
revit_grid = Curve([<curve referenced from the Rhino model> x5])
# roof
# beam
# floor
# curtain wall
# wall
reference_by_layer = ReferenceByLayer(LayerName=linear_grid, DisableAutoUpdate=False)
reference_by_layer_2 = ReferenceByLayer(LayerName=arc_grid, DisableAutoUpdate=False)
reference_by_layer_3 = ReferenceByLayer(LayerName=grid, DisableAutoUpdate=False)

# ----
exterior_wall = ValueList({"constructCrv", "constructCrv::Layer 01", "constructCrv::Layer 03", "Default", "i_geometry", "i_geometry::grid", "i_geometry::grid::arcGrid", "i_geometry::grid::linearGrid", "i_geometry::roofCrv", "i_revit", "i_revit::door", "i_revit::door::BlockLine", "i_revit::door::dim", "i_revit::door::DoorGeo", "i_revit::floor", "i_revit::floor::bath", "i_revit::floor::living", "i_revit::floor::mep", "i_revit::floor::pool", "i_revit::floor::terrace", "i_revit::floor::wc", "i_revit::wall", "i_revit::wall::curtain", "i_revit::wall::ext wall", "i_revit::wall::int wall", "site", "site::pool", "site::roof3d", "site::sand"}, selected="i_revit::wall::ext wall")
curtain_wall = ValueList({"constructCrv", "constructCrv::Layer 01", "constructCrv::Layer 03", "Default", "i_geometry", "i_geometry::grid", "i_geometry::grid::arcGrid", "i_geometry::grid::linearGrid", "i_geometry::roofCrv", "i_revit", "i_revit::door", "i_revit::door::BlockLine", "i_revit::door::dim", "i_revit::door::DoorGeo", "i_revit::floor", "i_revit::floor::bath", "i_revit::floor::living", "i_revit::floor::mep", "i_revit::floor::pool", "i_revit::floor::terrace", "i_revit::floor::wc", "i_revit::wall", "i_revit::wall::curtain", "i_revit::wall::ext wall", "i_revit::wall::int wall", "site", "site::pool", "site::roof3d", "site::sand"}, selected="i_revit::wall::curtain")
interior_wall = ValueList({"constructCrv", "constructCrv::Layer 01", "constructCrv::Layer 03", "Default", "i_geometry", "i_geometry::grid", "i_geometry::grid::arcGrid", "i_geometry::grid::linearGrid", "i_geometry::roofCrv", "i_revit", "i_revit::door", "i_revit::door::BlockLine", "i_revit::door::dim", "i_revit::door::DoorGeo", "i_revit::floor", "i_revit::floor::bath", "i_revit::floor::living", "i_revit::floor::mep", "i_revit::floor::pool", "i_revit::floor::terrace", "i_revit::floor::wc", "i_revit::wall", "i_revit::wall::curtain", "i_revit::wall::ext wall", "i_revit::wall::int wall", "site", "site::pool", "site::roof3d", "site::sand"}, selected="i_revit::wall::int wall")
reference_by_layer_4 = ReferenceByLayer(LayerName=interior_wall, DisableAutoUpdate=False)
reference_by_layer_5 = ReferenceByLayer(LayerName=exterior_wall, DisableAutoUpdate=False)
reference_by_layer_6 = ReferenceByLayer(LayerName=curtain_wall, DisableAutoUpdate=False)

# ---- group: floors
terrace = ValueList({"constructCrv", "constructCrv::Layer 01", "constructCrv::Layer 03", "Default", "i_geometry", "i_geometry::grid", "i_geometry::grid::arcGrid", "i_geometry::grid::linearGrid", "i_geometry::roofCrv", "i_revit", "i_revit::door", "i_revit::door::BlockLine", "i_revit::door::dim", "i_revit::door::DoorGeo", "i_revit::floor", "i_revit::floor::bath", "i_revit::floor::living", "i_revit::floor::mep", "i_revit::floor::pool", "i_revit::floor::terrace", "i_revit::floor::wc", "i_revit::wall", "i_revit::wall::curtain", "i_revit::wall::ext wall", "i_revit::wall::int wall", "site", "site::pool", "site::roof3d", "site::sand"}, selected="i_revit::floor::terrace")
living = ValueList({"constructCrv", "constructCrv::Layer 01", "constructCrv::Layer 03", "Default", "i_geometry", "i_geometry::grid", "i_geometry::grid::arcGrid", "i_geometry::grid::linearGrid", "i_geometry::roofCrv", "i_revit", "i_revit::door", "i_revit::door::BlockLine", "i_revit::door::dim", "i_revit::door::DoorGeo", "i_revit::floor", "i_revit::floor::bath", "i_revit::floor::living", "i_revit::floor::mep", "i_revit::floor::pool", "i_revit::floor::terrace", "i_revit::floor::wc", "i_revit::wall", "i_revit::wall::curtain", "i_revit::wall::ext wall", "i_revit::wall::int wall", "site", "site::pool", "site::roof3d", "site::sand"}, selected="i_revit::floor::living")
mep = ValueList({"constructCrv", "constructCrv::Layer 01", "constructCrv::Layer 03", "Default", "i_geometry", "i_geometry::grid", "i_geometry::grid::arcGrid", "i_geometry::grid::linearGrid", "i_geometry::roofCrv", "i_revit", "i_revit::door", "i_revit::door::BlockLine", "i_revit::door::dim", "i_revit::door::DoorGeo", "i_revit::floor", "i_revit::floor::bath", "i_revit::floor::living", "i_revit::floor::mep", "i_revit::floor::pool", "i_revit::floor::terrace", "i_revit::floor::wc", "i_revit::wall", "i_revit::wall::curtain", "i_revit::wall::ext wall", "i_revit::wall::int wall", "site", "site::pool", "site::roof3d", "site::sand"}, selected="i_revit::floor::mep")
bath = ValueList({"constructCrv", "constructCrv::Layer 01", "constructCrv::Layer 03", "Default", "i_geometry", "i_geometry::grid", "i_geometry::grid::arcGrid", "i_geometry::grid::linearGrid", "i_geometry::roofCrv", "i_revit", "i_revit::door", "i_revit::door::BlockLine", "i_revit::door::dim", "i_revit::door::DoorGeo", "i_revit::floor", "i_revit::floor::bath", "i_revit::floor::living", "i_revit::floor::mep", "i_revit::floor::pool", "i_revit::floor::terrace", "i_revit::floor::wc", "i_revit::wall", "i_revit::wall::curtain", "i_revit::wall::ext wall", "i_revit::wall::int wall", "site", "site::pool", "site::roof3d", "site::sand"}, selected="i_revit::floor::bath")
wc = ValueList({"constructCrv", "constructCrv::Layer 01", "constructCrv::Layer 03", "Default", "i_geometry", "i_geometry::grid", "i_geometry::grid::arcGrid", "i_geometry::grid::linearGrid", "i_geometry::roofCrv", "i_revit", "i_revit::door", "i_revit::door::BlockLine", "i_revit::door::dim", "i_revit::door::DoorGeo", "i_revit::floor", "i_revit::floor::bath", "i_revit::floor::living", "i_revit::floor::mep", "i_revit::floor::pool", "i_revit::floor::terrace", "i_revit::floor::wc", "i_revit::wall", "i_revit::wall::curtain", "i_revit::wall::ext wall", "i_revit::wall::int wall", "site", "site::pool", "site::roof3d", "site::sand"}, selected="i_revit::floor::wc")
reference_by_layer_7 = ReferenceByLayer(LayerName=living, DisableAutoUpdate=False)
reference_by_layer_8 = ReferenceByLayer(LayerName=mep, DisableAutoUpdate=False)
reference_by_layer_9 = ReferenceByLayer(LayerName=bath, DisableAutoUpdate=False)
reference_by_layer_10 = ReferenceByLayer(LayerName=wc, DisableAutoUpdate=False)
reference_by_layer_11 = ReferenceByLayer(LayerName=terrace, DisableAutoUpdate=False)

# ---- group: rafters
roof_curves = ValueList({"Default", "guildCrv", "guildCrv::Layer 01", "i_geometry", "i_geometry::grid", "i_geometry::grid::arcGrid", "i_geometry::roofCrv", "i_revit", "i_revit::curtain", "i_revit::ext wall", "i_revit::floor", "i_revit::int wall", "site", "site::pool", "site::sand"}, selected="i_geometry::roofCrv")
reference_by_layer_12 = ReferenceByLayer(LayerName=roof_curves, DisableAutoUpdate=False)
curve_middle = CurveMiddle(Curve=reference_by_layer_12)
deconstruct = Deconstruct(Point=curve_middle)  # -> XComponent, YComponent, ZComponent
sort_list = SortList(Keys=deconstruct.YComponent, ValuesValuesA=reference_by_layer_12)  # -> Keys, ValuesValuesA
loft_options = LoftOptions(Closed=False, Adjust=True, Rebuild=0, Refit=8, Type=0)
list_item = ListItem(List=sort_list.ValuesValuesA, Index=0, Wrap=True)  # -> Item, Item1, Item2
curve = Curve(list_item.Item)
curve_2 = Curve(list_item.Item2)
curve_3 = Curve(list_item.Item1)
merge = Merge(Data1=curve_3, Data2=curve)
merge_2 = Merge(Data1=curve_3, Data2=curve_2)
loft = Loft(Curves=merge, Options=loft_options)
loft_2 = Loft(Curves=merge_2, Options=loft_options)
brep_join = BrepJoin(Breps=[loft, loft_2])  # -> Breps, Closed

# ---- group: site
value_list = ValueList({"constructCrv", "constructCrv::Layer 01", "constructCrv::Layer 03", "Default", "i_geometry", "i_geometry::grid", "i_geometry::grid::arcGrid", "i_geometry::grid::linearGrid", "i_geometry::roofCrv", "i_revit", "i_revit::door", "i_revit::door::BlockLine", "i_revit::door::dim", "i_revit::door::DoorGeo", "i_revit::floor", "i_revit::floor::bath", "i_revit::floor::living", "i_revit::floor::mep", "i_revit::floor::pool", "i_revit::floor::terrace", "i_revit::floor::wc", "i_revit::wall", "i_revit::wall::curtain", "i_revit::wall::ext wall", "i_revit::wall::int wall", "site", "site::pool", "site::roof3d", "site::sand"}, selected="i_revit::floor::pool")
curve_4 = Curve([<curve referenced from the Rhino model> x9])
divide_length = DivideLength(Curve=curve_4, Length="1000")  # -> flatten(Points), Tangents, Parameters
reference_by_layer_13 = ReferenceByLayer(LayerName=value_list, DisableAutoUpdate=False)
add_topography_points = AddTopographyPoints(Points=divide_length.Points, TrackingMode=2)
add_buildingpad = AddBuildingPad(Boundary=reference_by_layer_13, TrackingMode=2)
element_parameter = ElementParameter(Element=add_buildingpad, Parameter="Height Offset From Level", Value="-1350")  # -> Element, Value

# ---- group: floors
query_types = QueryTypes(Kind=3)
panel_2 = Panel("""*Floor 350mm*
*Floor 250mm*
*Floor 200mm*
*MEP 150mm*""")
element_name = ElementName(Element=query_types)  # -> Element, Name
match_text = MatchText(Text=element_name.Name, Pattern=graft(panel_2), Case=True)
cull_pattern = CullPattern(List=element_name.Element, CullPattern=match_text)  # -> flatten(List)
list_item_2 = ListItem(List=cull_pattern, Index=0, Wrap=True)  # -> Item, Item1, Item2, Item3

# ---- group: wall / interior
curve_middle_2 = CurveMiddle(Curve=reference_by_layer_4)
deconstruct_2 = Deconstruct(Point=curve_middle_2)  # -> XComponent, YComponent, ZComponent
sort_list_2 = SortList(Keys=deconstruct_2.XComponent, ValuesValuesA=reference_by_layer_4)  # -> Keys, ValuesValuesA
curve_5 = Curve(sort_list_2.ValuesValuesA)

# ---- group: wall / curtain
curve_middle_3 = CurveMiddle(Curve=reference_by_layer_6)
deconstruct_3 = Deconstruct(Point=curve_middle_3)  # -> XComponent, YComponent, ZComponent
sort_list_3 = SortList(Keys=deconstruct_3.XComponent, ValuesValuesA=reference_by_layer_6)  # -> Keys, ValuesValuesA
curve_6 = Curve(sort_list_3.ValuesValuesA)

# ----
view_family = ViewFamily({"3D View": 102, "Floor Plan": 109, "Ceiling Plan": 111, "Structural Plan": 120, "Area Plan": 110, "Elevation": 114, "Section": 112, "Detail View": 113, "Drafting View": 108, "Rendering": 104, "Walkthrough": 103, "Legend": 117, "Sheet": 107, "Schedule": 105, "Graphical Column Schedule": 119, "Panel Schedule": 118, "Cost Report": 106, "Loads Report": 115, "Pressure Loss Report": 116, "Systems Analysis Report": 121}, selected="Floor Plan")
query_views = QueryViews(ViewFamily=view_family, ViewName="Ground Level", IsDependent=False, IsTemplate=False)
curve_7 = Curve(reference_by_layer)
add_detail_line = AddDetailLine(View=query_views, Curve=curve_7, TrackingMode=2)

# ---- group: wall / exterior
is_curve_linear = IsCurveLinear(Curve=reference_by_layer_5)
cull_pattern_2 = CullPattern(List=reference_by_layer_5, CullPattern=is_curve_linear)
cull_pattern_3 = CullPattern(List=reference_by_layer_5, CullPattern=invert(is_curve_linear))

# ---- group: revit grid
curve_middle_4 = CurveMiddle(Curve=reference_by_layer)
sort_points = SortPoints(Points=curve_middle_4)  # -> Points, Indices
list_item_3 = ListItem(List=reference_by_layer, Index=sort_points.Indices, Wrap=True)

# ---- group: mass roof surface
geometry = Geometry(brep_join.Breps)
file_path = FilePath("C:\ProgramData\Autodesk\RVT 2023\Family Templates\English\Conceptual Mass\Metric Mass.rft")
category = Category(<category referenced from the Revit model>)
component_family_form = ComponentFamilyForm(Brep=geometry)
new_component_family = NewComponentFamily(
    Document={ModelURI="file:///D:/WORKS/2020/kkaa/work/revit/dune 1 bed.rvt", PathName="D:\WORKS\2020\kkaa\work\revit\dune 1 bed.rvt"},
    Overwrite=Toggle(True),
    Name="mass roof surface",
    Category=category,
    Geometry=component_family_form)
family_types = FamilyTypes(Family=new_component_family)
xy_plane = XYPlane(Origin=Point(0, 0, 0))
add_component_location = AddComponentLocation(Location=xy_plane, Type=family_types, Level=<geometry referenced from the Revit model>, TrackingMode=2)
element_parameter_2 = ElementParameter(Element=add_component_location, Parameter="Offset from Host", Value="0")  # -> Element, Parameter, Value

# ---- group: floors
curve_8 = Curve(reference_by_layer_11)
curve_9 = Curve(reference_by_layer_8)
curve_10 = Curve(reference_by_layer_9)
curve_11 = Curve(reference_by_layer_7)
curve_12 = Curve(reference_by_layer_10)
region_union = RegionUnion(Curves=[curve_10, curve_12, curve_11])
add_floor = AddFloor(
    Boundary=graft(curve_8),
    Type=list_item_2.Item1,
    Level=<geometry referenced from the Revit model>,
    Structural=True,
    TrackingMode=2)
add_floor_2 = AddFloor(
    Boundary=graft(curve_10),
    Type=list_item_2.Item2,
    Level=<geometry referenced from the Revit model>,
    Structural=True,
    TrackingMode=2)
add_floor_3 = AddFloor(
    Boundary=graft(curve_9),
    Type=list_item_2.Item3,
    Level=<geometry referenced from the Revit model>,
    Structural=True,
    TrackingMode=2)
add_floor_4 = AddFloor(Boundary=graft(curve_11), Level=<geometry referenced from the Revit model>, Structural=True, TrackingMode=2)
add_floor_5 = AddFloor(Boundary=graft(curve_12), Level=<geometry referenced from the Revit model>, Structural=True, TrackingMode=2)

element_parameter_3 = ElementParameter(Element=flatten(add_floor), Parameter="Height Offset From Level", Value="-180")  # -> Element, Value

# ---- group: make walls
roof = Brep(brep_join.Breps)
project = Project(Curve=cull_pattern_2, Brep=roof, Direction=Vector(0, 0, 1))
merge_3 = Merge(Data1=graft(cull_pattern_2), Data2=project)
list_item_4 = ListItem(List=merge_3, Index=0, Wrap=True)
flip_curve = FlipCurve(Curve=merge_3, Guide=list_item_4)  # -> Curve, Flag
loft_3 = Loft(
    Curves=flip_curve.Curve,
    Options={Adjust=False, Closed=False, LoftEnds=0, LoftSimp=0, LoftType=0, Rebuild=10, Refit=0.01})
discontinuity = Discontinuity(Curve=loft_3, Level=1)  # -> Points, Parameters
polyline = PolyLine(Vertices=discontinuity.Points, Closed=True)  # -> flatten(Polyline)

roof_2 = Brep(brep_join.Breps)
project_2 = Project(Curve=curve_5, Brep=roof_2, Direction=Vector(0, 0, 1))
merge_4 = Merge(Data1=graft(curve_5), Data2=project_2)
list_item_5 = ListItem(List=merge_4, Index=0, Wrap=True)
flip_curve_2 = FlipCurve(Curve=merge_4, Guide=list_item_5)  # -> Curve, Flag
loft_4 = Loft(
    Curves=flip_curve_2.Curve,
    Options={Adjust=False, Closed=False, LoftEnds=0, LoftSimp=0, LoftType=0, Rebuild=10, Refit=0.01})
discontinuity_2 = Discontinuity(Curve=loft_4, Level=1)  # -> Points, Parameters
polyline_2 = PolyLine(Vertices=discontinuity_2.Points, Closed=True)  # -> flatten(Polyline)

# ---- group: long beam
number_slider = Slider(600, range=0..1000)
number_slider_2 = Slider(250, range=0..1000)

# ---- group: make walls
query_types_2 = QueryTypes(Kind=3)
element_name_2 = ElementName(Element=query_types_2)  # -> Element, Name
match_text_2 = MatchText(Text=element_name_2.Name, Pattern="*Interior - 200*", Case=True)
match_text_3 = MatchText(Text=element_name_2.Name, Pattern="*360*", Case=True)
match_text_4 = MatchText(Text=element_name_2.Name, Pattern="Curtain Wall", Case=True)
cull_pattern_4 = CullPattern(List=element_name_2.Element, CullPattern=match_text_3)
cull_pattern_5 = CullPattern(List=element_name_2.Element, CullPattern=match_text_2)
cull_pattern_6 = CullPattern(List=element_name_2.Element, CullPattern=match_text_4)

# ----
number_slider_3 = Slider(30, range=0..100)

unit_z = UnitZ(Factor=number_slider_3)

number_slider_4 = Slider(80, range=0..1000)
curve_13 = Curve(reference_by_layer)
offset_curve = OffsetCurve(
    Curve=curve_13,
    Plane=PlaneXY(0, 0, 0),
    Distance=expr("x/2", number_slider_4),
    BothSides=expr("-x/2", number_slider_4),
    Kinks=0,
    CapType=1)  # -> flatten(Offset)
area = Area(Geometry=offset_curve)  # -> Area, Centroid
mass_addition = MassAddition(Input=flatten(area.Area))  # -> Result, PartialResults

# ---- group: rafters / upper rafter
thickness = Slider(80, range=0..100)
depth = Slider(250, range=0..1000)
hieght = Slider(250, range=0..1000)

# ---- group: rafters / dimensions / lower rafter
depth_2 = Slider(250, range=0..1000)
hieght_2 = Slider(450, range=0..1000)

# ---- group: doors / Door Blocks
list_block_document = ListBlockDocument()
reference_block_by_name = ReferenceBlockByName(BlockName=list_block_document)  # -> flatten(Block)
match_text_5 = MatchText(Text=reference_block_by_name, Pattern="*BlockLine Door*", Case=True)
match_text_6 = MatchText(Text=reference_block_by_name, Pattern="*BlockLine SlidingDoor*", Case=True)
cull_pattern_7 = CullPattern(List=reference_block_by_name, CullPattern=match_text_5)
cull_pattern_8 = CullPattern(List=reference_block_by_name, CullPattern=match_text_6)

# ---- group: doors
directshape_categories = DirectShapeCategories("autodesk.revit.category.local:walls-1.0.0", SearchPattern="Wall")
category_filter = CategoryFilter(Categories=directshape_categories, Inverted=False)
query_elements = QueryElements(Filter=category_filter)  # -> Elements, Count
wall = Wall(query_elements.Elements)
analyze_wall_location_curve = AnalyzeWallLocationCurve(Wall=wall)  # -> LocationLine, CenterCurve, LocationCurve, OffsetValue

# ---- group: doors / find wall index
# Find wall index which nearest each door
deconstruct_block = DeconstructBlock(Block=cull_pattern_7)  # -> flatten(Name), flatten(Plane), flatten(Geometry)
point = Point(flatten(deconstruct_block.Plane))
curve_14 = Curve(analyze_wall_location_curve.LocationCurve)
length = Length(Curve=deconstruct_block.Geometry)  # -> expr("round(x)", Length)
ghpython_script = GhPythonScript(iPoints=point, iCurves=curve_14)  # -> oIndices; inputs iPoints: list of Point3d, iCurves: list of Curve
# ---------- ghpython_script: Python ----------
import Rhino.Geometry as rg

indices = []

for point in iPoints:
    distances = []
    for curve in iCurves:
        curve.Domain = rg.Interval(0, 1)
        param = curve.ClosestPoint(point)[1]
        closestPoint = curve.PointAt(param)
        distances.append(point.DistanceTo(closestPoint))
    index = distances.index(min(distances))
    indices.append(index)

oIndices = indices
# ---------- end ghpython_script ----------
list_item_6 = ListItem(List=wall, Index=ghpython_script, Wrap=True)
wall_2 = Wall(list_item_6)

# Find wall index which nearest each door
deconstruct_block_2 = DeconstructBlock(Block=cull_pattern_8)  # -> flatten(Name), flatten(Plane), flatten(Geometry)
point_2 = Point(flatten(deconstruct_block_2.Plane))
curve_15 = Curve(analyze_wall_location_curve.LocationCurve)
length_2 = Length(Curve=deconstruct_block_2.Geometry)  # -> expr("round(x)", Length)
ghpython_script_2 = GhPythonScript(iPoints=point_2, iCurves=curve_15)  # -> oIndices; inputs iPoints: list of Point3d, iCurves: list of Curve; same code as ghpython_script
list_item_7 = ListItem(List=wall, Index=ghpython_script_2, Wrap=True)
wall_3 = Wall(list_item_7)

# ---- group: shingle
number_slider_5 = Slider(30, range=0..100)
number_slider_6 = Slider(20, range=0..100)

extend = Slider(15, range=0..1000)
rotate = Slider(2.45, range=0..10)
length_3 = Slider(300, range=0..1000)
repetition = Slider(3, range=0..10)

# ---- group: make rafter
panel_3 = Panel("rafter dune villa")
query_types_3 = QueryTypes(
    Document={ModelURI="file:///D:/WORKS/2020/kkaa/work/revit/dune 1 bed.rvt", PathName="D:\WORKS\2020\kkaa\work\revit\dune 1 bed.rvt"},
    Kind=3,
    FamilyName=panel_3,
    TypeName="Upper Rafter")

# ---- group: doors / find type index
panel_4 = Panel("""750
900
1200""")
ghpython_script_3 = GhPythonScript(iLengths=length, iTypes=panel_4)  # -> oIndices; inputs iLengths: list, iTypes: list
# ---------- ghpython_script_3: Python ----------
indices = []

for lengthStr in iLengths:
    for i, type in enumerate(iTypes):
        if lengthStr in type:
            indices.append(i)

oIndices = indices
# ---------- end ghpython_script_3 ----------

# ----
query_types_4 = QueryTypes(
    Document={ModelURI="file:///D:/WORKS/2020/kkaa/work/revit/dune 1 bed.rvt", PathName="D:\WORKS\2020\kkaa\work\revit\dune 1 bed.rvt"},
    Kind=3,
    FamilyName=panel_3,
    TypeName="Lower Rafter")

# ---- group: doors
text = Text(panel_4)
query_types_5 = QueryTypes(Kind=3, FamilyName="M_Single-Flush", TypeName=text)

query_types_6 = QueryTypes(Kind=3, FamilyName="interior sliding door")

list_item_8 = ListItem(List=flatten(query_types_5), Index=ghpython_script_3, Wrap=True)
plane = Plane(deconstruct_block.Plane)
add_component_location_2 = AddComponentLocation(
    Location=graft(plane),
    Type=graft(list_item_8),
    Level=<geometry referenced from the Revit model>,
    Host=graft(wall_2),
    TrackingMode=2)

plane_2 = Plane(deconstruct_block_2.Plane)
add_component_location_3 = AddComponentLocation(
    Location=graft(plane_2),
    Type=graft(query_types_6),
    Level=<geometry referenced from the Revit model>,
    Host=graft(wall_3),
    TrackingMode=2)

# ----
number_slider_7 = Slider(30, range=0..100)
number_slider_8 = Slider(30, range=0..100)

debug = BooleanToggle(True)
k__key_geometry = ColourSwatch(SwatchColor=RGB(255, 144, 54))
p_param = ColourSwatch(SwatchColor=RGBA(54, 145, 224, 150))
e__execute = ColourSwatch(SwatchColor=RGBA(242, 24, 24, 150))
a__analyze = ColourSwatch(SwatchColor=RGB(165, 204, 165))
geo_geometry = ColourSwatch(SwatchColor=RGB(64, 145, 64))
gr_groups = ColourSwatch(SwatchColor=RGB(204, 204, 204))
r_revit = ColourSwatch(SwatchColor=RGBA(102, 0, 255, 131))
# Automatically color groups based on prefix
# By Mathias Sønderskov Schaltz 2022
i_inputs = ColourSwatch(SwatchColor=RGBA(255, 231, 54, 150))

# ----
# Do not modify this
# component without setting
# enable to false first!
colorgroups = CSharpScript(
    Colors=[i_inputs, geo_geometry, e__execute, p_param, gr_groups, r_revit, k__key_geometry, a__analyze],
    Enable=Toggle(True),
    debug=debug)  # -> out; inputs Colors: list of Color, Enable: Boolean, debug: Boolean
# ---------- colorgroups: C# usings ----------
using System.Linq;
using System.Text;
# ---------- colorgroups: C# ----------
    msg.Clear();
    msg.AppendFormat("Set up events on ID {0}\n", id);
    this.Component.Message = "id: " + id.ToString();

    _debug = debug; //Set to true to have all events printed in rhino log

    if (Enable)
    {
      SetupDict(); // Create a dictionary of the input swatches
      SetEventHandlers(); // This would do the job.

      foreach(Grasshopper.Kernel.Special.GH_Group grp in GrasshopperDocument.Objects.OfType<Grasshopper.Kernel.Special.GH_Group>())
      {
        //ColorGroup(grp, null); // You decide if it should run once on all existing groups
      }
    }
    else
    {
      RemoveEventHandlers();
    }

    Print(msg.ToString());


    // Component setup
    Component.Description = "Set up event handlers to color groups based on prefixes such as 'in_' and 'out_'.\n"
      + "Please insert only swatcheds directly into the Colors input\n\n"
      + "MIT License. Copyright Mathias Sønderskov Schaltz 2022";
    Component.Params.Input[0].Description = "Please insert only swatcheds directly into the Colors input.\nRemember to rename them";
    Component.Params.Input[1].Description = "Toggle to run...";
    Component.Params.Input[2].Description = "Set debug to true to get all the events printed in the rhino log";
# ---------- colorgroups: C# additional code ----------
  int id = 0;
  Dictionary<string, System.Drawing.Color> colorDict = new Dictionary<string, System.Drawing.Color>();
  StringBuilder msg = new StringBuilder();
  bool _debug = false;


  public void SetupDict()
  {
    colorDict.Clear();
    // Get all inputs to "Colors"
    IList<IGH_Param> colorSources = this.Component.Params.Input[0].Sources;
    if (colorSources.Count == 0)
    {
      throw new Exception("You forgot to setup the colors. Please input swatch components and rename them");
    }
    foreach(IGH_Param source in colorSources)
    {
      //if (source.Type.ToString() == "Grasshopper.Kernel.Types.GH_Colour")
      if (source is Grasshopper.Kernel.Special.GH_ColourSwatch)
      {
        string nickName = source.NickName.Split('_')[0].Trim() + '_';
        if(!colorDict.ContainsKey(nickName))
        {
          Grasshopper.Kernel.Special.GH_ColourSwatch swatch = (Grasshopper.Kernel.Special.GH_ColourSwatch) source;
          colorDict.Add(nickName, swatch.SwatchColour);
        }
        else
        {
          throw new Exception("Multiple swatches using the same name detected. Please rename");
        }
      }
      else
      {
        throw new Exception("Whacko! Why did you input a non-swatch into the Colors? " + source.Type.ToString());
      }

    }

    msg.AppendFormat("Set up the dictionaries with {0} colors\n", colorDict.Count);
    foreach(var pairs in colorDict)
    {
      msg.AppendFormat("{0} -> {1}\n", ("\"" + pairs.Key + "\"").PadRight(5 + colorDict.Keys.Select(k => k.Length).Max()), pairs.Value);
    }
  }

  public void SetEventHandlers()
  {

    // Always remove events first to avoid duplicates
    GrasshopperDocument.ObjectsAdded -= OnObjectsAdded;
    GrasshopperDocument.ObjectsDeleted -= OnObjectsRemoved;
    GrasshopperDocument.ObjectsDeleted -= DeleteThisComponent;

    // Attach events
    GrasshopperDocument.ObjectsAdded += OnObjectsAdded;
    GrasshopperDocument.ObjectsDeleted += OnObjectsRemoved;
    GrasshopperDocument.ObjectsDeleted += DeleteThisComponent;


    foreach(Grasshopper.Kernel.Special.GH_Group grp in GrasshopperDocument.Objects.OfType<Grasshopper.Kernel.Special.GH_Group>())
    {
      grp.ObjectChanged -= ColorGroup;
      grp.ObjectChanged += ColorGroup;

      ColorGroup(grp, null); // Make sure to run it once
    }
    msg.AppendFormat("Added the eventhandlers on {0} existing groups and on future created groups", GrasshopperDocument.Objects.OfType<Grasshopper.Kernel.Special.GH_Group>().Count());
  }

  public void OnObjectsAdded(object sender, GH_DocObjectEventArgs e)
  {
    bool any = false;
    foreach (Grasshopper.Kernel.Special.GH_Group grp in e.Objects.OfType<Grasshopper.Kernel.Special.GH_Group>())
    {
      grp.ObjectChanged -= ColorGroup;
      grp.ObjectChanged += ColorGroup;
      any = true;
    }

    DebugWrite(any ? "Group Objects Added: Attaching Events to ObjectChanged" : "Objects Added - but no groups");
  }

  //Same but reversed
  public void OnObjectsRemoved(object sender, GH_DocObjectEventArgs e)
  {
    bool any = false;
    foreach (Grasshopper.Kernel.Special.GH_Group grp in e.Objects.OfType<Grasshopper.Kernel.Special.GH_Group>())
    {
      grp.ObjectChanged -= ColorGroup;
      any = true;
    }

    DebugWrite(any ? "Group Objects Removed, removing event" : "Objects Removed - although not a group");

  }



  public void RemoveEventHandlers()
  {
    GrasshopperDocument.ObjectsAdded -= OnObjectsAdded;
    GrasshopperDocument.ObjectsDeleted -= OnObjectsRemoved;


    foreach(Grasshopper.Kernel.Special.GH_Group grp in GrasshopperDocument.Objects.OfType<Grasshopper.Kernel.Special.GH_Group>())
    {
      grp.ObjectChanged -= ColorGroup;

    }
    msg.AppendFormat("Removed event handlers on document and on {0} groups\n", GrasshopperDocument.Objects.OfType<Grasshopper.Kernel.Special.GH_Group>().Count());

  }

  public void ColorGroup(object sender, EventArgs e)
  {

    Grasshopper.Kernel.Special.GH_Group grp = sender as Grasshopper.Kernel.Special.GH_Group;
    if (grp == null) return; //not type GH_Group
    //if (!grp.NickName.EndsWith("_")) return;


    string prefix = grp.NickName.Split('_')[0].Trim() + '_';

    string prefixes = String.Join(", ", colorDict.Keys.Select(k => "\"" + k + "\""));


    if (colorDict.ContainsKey(prefix))
    {
      if (grp.NickName.EndsWith("_"))
        grp.Colour = colorDict[prefix];
      grp.NickName = grp.NickName.Replace(prefix, "");

      DebugWrite("Colored " + grp.NickName);

    }
    else
    {
      //DebugWrite("Group changed but not relevant: prefix " + prefix + " is not among " + prefixes);
    }

  }
  public void DebugWrite(string msg)
  {
    if (_debug)
    {
      Rhino.RhinoApp.WriteLine(String.Format("[ColGrps {0}]: {1}", id, msg));
    }
  }

  public void DeleteThisComponent(object sender, GH_DocObjectEventArgs e)
  {

    if (e.Objects.OfType<Grasshopper.Kernel.GH_Component>().Where(o => o.NickName == this.Component.NickName).Any())
    {
      DebugWrite("Removed template component. Removing all the eventhandlers");
      RemoveEventHandlers();
    }


  }
# ---------- end colorgroups ----------

panel_5 = Panel(colorgroups)

# ---- group: rafters
curve_16 = Curve(revit_grid)
curve_17 = Curve(reference_by_layer_3)
sort_crvs = GhPythonScript(iCrvs=curve_17)  # -> output; inputs iCrvs: list of Curve
# ---------- sort_crvs: Python ----------
import Rhino.Geometry as rg


def SortList(list1, list2) :
    zippedPairs = zip(list2, list1)
    sortedList = [x for _, x in sorted(zippedPairs)]

    return sortedList


def FlipCrvs(curves) :
    for i in range(len(curves) - 1) :
        curves[i].Domain = rg.Interval(0.0, 1.0)
        if curves[i].PointAt(0).DistanceTo(curves[i + 1].PointAt(0)) > curves[i].PointAt(0).DistanceTo(curves[i + 1].PointAt(1)) :
            curves[i + 1].Reverse()

    return curves


def SortCrvs(curves) :
    points = []
    for curve in curves :
        curve.Domain = rg.Interval(0.0, 1.0)
        points.append(curve.PointAt(0.5))
    sortedPoints = rg.Point3d.SortAndCullPointList(points, 10)
    guildCrv = rg.Curve.CreateInterpolatedCurve(sortedPoints, 3)

    params = []
    guildCrv.Domain = rg.Interval(0.0, 1.0)
    for i, curve in enumerate(curves) :
        curve.Domain = rg.Interval(0.0, 1.0)
        param = guildCrv.ClosestPoint(curve.PointAt(0.5))[1]
        params.append(param)

    sortCrvs = SortList(curves, params)
    flipCrvs = FlipCrvs(sortCrvs)

    return flipCrvs


output = SortCrvs(iCrvs)
# ---------- end sort_crvs ----------

curve_middle_5 = CurveMiddle(Curve=curve_16)
sort_points_2 = SortPoints(Points=curve_middle_5)  # -> Points, Indices
list_item_9 = ListItem(List=curve_16, Index=sort_points_2.Indices, Wrap=True)
flip_curves = GhPythonScript(iCrvs=list_item_9)  # -> output; inputs iCrvs: list of Curve
# ---------- flip_curves: Python ----------
import Rhino.Geometry as rg

def FlipCrvs(curves) :
    for i in range(len(curves) - 1) :
        curves[i].Domain = rg.Interval(0.0, 1.0)
        if curves[i].PointAt(0).DistanceTo(curves[i + 1].PointAt(0)) > curves[i].PointAt(0).DistanceTo(curves[i + 1].PointAt(1)) :
            curves[i + 1].Reverse()

    return curves

output = FlipCrvs(iCrvs)
# ---------- end flip_curves ----------

# ---- group: long beam
revit_grid_2 = Curve(flip_curves)
curve_18 = Curve(reparameterize(revit_grid_2))
list_item_10 = ListItem(List=reverse(curve_18), Index=0, Wrap=True)

curve_19 = Curve(flip_curves)
end_points = EndPoints(Curve=curve_19)  # -> Start, End
vector_2pt = Vector2Pt(PointA=end_points.Start, PointB=end_points.End, Unitize=False)  # -> Vector, Length
unit_z_2 = UnitZ(Factor=1)
construct_plane = ConstructPlane(Origin=end_points.Start, XAxis=vector_2pt.Vector, YAxis=unit_z_2)

# ---- group: rafters
list_item_11 = ListItem(List=reverse(flip_curves), Index=5, Wrap=True)
curve_middle_6 = CurveMiddle(Curve=list_item_11)
curve_middle_7 = CurveMiddle(Curve=sort_crvs)
deconstruct_4 = Deconstruct(Point=curve_middle_7)  # -> XComponent, YComponent, ZComponent
deconstruct_5 = Deconstruct(Point=curve_middle_6)  # -> XComponent, YComponent, ZComponent
smaller_than = SmallerThan(FirstNumber=deconstruct_4.XComponent, SecondNumber=deconstruct_5.XComponent)  # -> SmallerThan, OrEqualTo
cull_pattern_9 = CullPattern(List=sort_crvs, CullPattern=smaller_than.SmallerThan)

end_points_2 = EndPoints(Curve=sort_crvs)  # -> Start, End
vector_2pt_2 = Vector2Pt(PointA=end_points_2.Start, PointB=end_points_2.End, Unitize=False)  # -> Vector, Length
unit_z_3 = UnitZ(Factor=1)
construct_plane_2 = ConstructPlane(Origin=end_points_2.Start, XAxis=vector_2pt_2.Vector, YAxis=unit_z_3)

# ---- group: long beam
curve_20 = Curve(reference_by_layer_2)

# ---- group: long beam / seperate long beam
end_points_3 = EndPoints(Curve=list_item_10)  # -> Start, End
unit_z_4 = UnitZ(Factor=1)
vector_2pt_3 = Vector2Pt(PointA=end_points_3.Start, PointB=end_points_3.End, Unitize=False)  # -> Vector, Length
construct_plane_3 = ConstructPlane(Origin=end_points_3.Start, XAxis=vector_2pt_3.Vector, YAxis=unit_z_4)
curve_plane = CurvePlane(Curve=graft(curve_20), Plane=construct_plane_3)  # -> Points, ParamsC, ParamsP
shatter = Shatter(Curve=graft(curve_20), Parameters=curve_plane.ParamsC)
list_item_12 = ListItem(List=shatter, Index=0, Wrap=True)  # -> Item, Item1
curve_21 = Curve(reparameterize(list_item_12.Item))
curve_22 = Curve(list_item_12.Item1)

# ----
number_slider_9 = Slider(250, range=0..1000)
curve_23 = Curve(curve_20)
offset_curve_2 = OffsetCurve(
    Curve=curve_23,
    Plane=PlaneXY(0, 0, 0),
    Distance=expr("x/2", number_slider_9),
    BothSides=expr("-x/2", number_slider_9),
    Kinks=0,
    CapType=1)  # -> flatten(Offset)
area_2 = Area(Geometry=offset_curve_2)  # -> Area, Centroid
mass_addition_2 = MassAddition(Input=area_2.Area)  # -> Result, PartialResults

# ---- group: revit grid
revit_grid_3 = Curve(revit_grid)
curve_24 = Curve(curve_20)
explode = Explode(Curve=curve_24, Recursive=True)  # -> flatten(Segments), Vertices
panel_6 = Panel("""A
B
C""")
add_grid = AddGrid(Curve=explode.Segments, Name=panel_6, TrackingMode=2)

# ----
sort_crvs_2 = GhPythonScript(iCrvs=revit_grid_3)  # -> output; inputs iCrvs: list of Curve; same code as sort_crvs

# ---- group: revit grid (continued)
list_length = ListLength(List=sort_crvs_2)
extend_curve = ExtendCurve(Curve=sort_crvs_2, Type=0, Start="1500", End="1500")
series = Series(Start=1, Step=1, Count=list_length)
add_grid_2 = AddGrid(Curve=extend_curve, Name=series, TrackingMode=2)

# ----
extend_curve_2 = ExtendCurve(Curve=explode.Segments, Type=2, Start="1500", End="1500")

# ---- group: rafters (continued)
plane_3 = Plane(construct_plane_2)

curve_plane_2 = CurvePlane(Curve=curve, Plane=plane_3)  # -> Points, ParamsC, ParamsP
curve_plane_3 = CurvePlane(Curve=curve_2, Plane=plane_3)  # -> Points, ParamsC, ParamsP
curve_plane_4 = CurvePlane(Curve=curve_3, Plane=plane_3)  # -> Points, ParamsC, ParamsP
line = Line(StartPoint=curve_plane_4.Points, EndPoint=curve_plane_2.Points)
line_2 = Line(StartPoint=curve_plane_4.Points, EndPoint=curve_plane_3.Points)
entwine = Entwine(Branch00=line, Branch01=line_2, FlattenInputs=True)

# ---- group: rafters / roof base surface
curve_25 = Curve(entwine)
loft_5 = GhPythonScript(iCrvs=curve_25)  # -> oSurfaces; inputs iCrvs: list of Curve
# ---------- loft_5: Python ----------
import rhinoscriptsyntax as rs
import Rhino.Geometry as rg

def LoftLines(list) :
    # loft lines in a list
    surfaces = []
    for i in range(len(list)-1) :
        brep = rg.Brep.CreateFromLoft([list[i], list[i + 1]], \
        rg.Point3d.Unset, rg.Point3d.Unset, \
        rg.LoftType.Normal, False)
        
        surface = brep[0].Surfaces[0]
        surfaces.append(surface)
    return surfaces

loftSrf = LoftLines(iCrvs)



oSurfaces = loftSrf
# ---------- end loft_5 ----------
brep_join_2 = BrepJoin(Breps=flatten(loft_5))  # -> Breps, Closed
brep = Brep(brep_join_2.Breps)

# ---- group: long beam
brep_2 = Brep(brep)
unit_z_5 = UnitZ(Factor=expr("-x", Slider(150, range=0..1000)))
move = Move(Geometry=brep_2, Motion=unit_z_5)  # -> Geometry, Transform

unit_z_6 = UnitZ(Factor=-10000)
move_2 = Move(Geometry=curve_21, Motion=unit_z_6)  # -> Geometry, Transform
unit_z_7 = UnitZ(Factor=1)
project_3 = Project(Curve=move_2.Geometry, Brep=move.Geometry, Direction=unit_z_7)  # -> flatten(Curve)
project_4 = Project(Curve=curve_22, Brep=move.Geometry, Direction=unit_z_7)  # -> flatten(Curve)

# ---- group: rafters / move up all rafters
unit_z_8 = UnitZ(Factor=Slider(0, range=0..10000))
move_3 = Move(Geometry=entwine, Motion=unit_z_8)  # -> Geometry, Transform

# ---- group: rafters / upper beam crvs
curve_26 = Curve(move_3.Geometry)

# ---- group: rafters
unit_z_9 = UnitZ(Factor=expr("-x", hieght))
move_4 = Move(Geometry=curve_26, Motion=unit_z_9)  # -> Geometry, Transform
horizontal_frame = HorizontalFrame(Curve=reparameterize(move_4.Geometry), Parameter=0)

# ---- group: rafters / calculate params
horizontal_frame_2 = HorizontalFrame(Curve=reparameterize(curve_26), Parameter=0)
project_5 = Project(Geometry=curve_26, Plane=horizontal_frame_2)  # -> Geometry, Transform
end_points_4 = EndPoints(Curve=curve_26)  # -> Start, End
end_points_5 = EndPoints(Curve=project_5.Geometry)  # -> Start, End
vector_2pt_4 = Vector2Pt(PointA=end_points_5.Start, PointB=end_points_5.End, Unitize=True)  # -> Vector, Length
vector_2pt_5 = Vector2Pt(PointA=end_points_4.Start, PointB=end_points_4.End, Unitize=True)  # -> Vector, Length
angle = Angle(VectorA=vector_2pt_4.Vector, VectorB=vector_2pt_5.Vector)  # -> Angle, Reflex
curve_27 = Curve(project_5.Geometry)

# ----
loft_6 = GhPythonScript(iCrvs=move_3.Geometry)  # -> oSurfaces; inputs iCrvs: list of Curve; same code as loft_5
brep_join_3 = BrepJoin(Breps=flatten(loft_6))  # -> Breps, Closed

unit_z_10 = UnitZ(Factor=10000)
geometry_2 = Geometry(region_union)
unit_z_11 = UnitZ(Factor=Slider(60, range=0..100))
extrude = Extrude(Base=geometry_2, Direction=unit_z_10)
extrude_2 = Extrude(Base=brep_join_3.Breps, Direction=unit_z_11)
addition = Addition(A=unit_z_11, B=unit_z)
move_5 = Move(Geometry=brep_join_3.Breps, Motion=addition)  # -> Geometry, Transform
unit_z_12 = UnitZ(Factor=number_slider_3)
solid_intersection = SolidIntersection(BrepsA=extrude_2, BrepsB=extrude)
extrude_3 = Extrude(Base=move_5.Geometry, Direction=unit_z_12)

# ---- group: rafters / rafter recess
number_slider_10 = Slider(700, range=0..1000)
addition_2 = Addition(A=number_slider_10, B=Slider(700, range=0..1000))
ghpython_script_4 = GhPythonScript(iCurves=curve_27, iRecess=number_slider_10)  # -> oLengths; inputs iCurves: tree of Curve, iRecess: Int32
# ---------- ghpython_script_4: Python ----------
import Rhino.Geometry as rg
import ghpythonlib.treehelpers as th

number = iRecess
lengths = []

curveLst = th.tree_to_list(iCurves)

for sublist in curveLst :
    list = [] 
    for curve in sublist :
        CurveLength = curve.GetLength()
        if CurveLength > number :
            CurveLength = CurveLength - number
        list.append(CurveLength)
    lengths.append(list)



oLengths = th.list_to_tree(lengths)
# ---------- end ghpython_script_4 ----------
ghpython_script_5 = GhPythonScript(iCurves=curve_27, iRecess=addition_2)  # -> oLengths; inputs iCurves: tree of Curve, iRecess: Int32; same code as ghpython_script_4

# ----
arc_grid_2 = Curve(reference_by_layer_2)
revit_grid_4 = Curve(revit_grid)
roof_crv = Curve(reference_by_layer_12)
extend_curve_3 = ExtendCurve(Curve=revit_grid_4, Type=0, Start=5000, End=5000)
project_6 = Project(Geometry=extend_curve_3, Plane=PlaneXY(0, 0, 0))  # -> Geometry, Transform
project_7 = Project(Geometry=roof_crv, Plane=PlaneXY(0, 0, 0))  # -> Geometry, Transform
curve_curve = CurveCurve(CurveA=graft(revit_grid_4), CurveB=arc_grid_2)  # -> Points, ParamsA, ParamsB
curve_curve_2 = CurveCurve(CurveA=graft(project_6.Geometry), CurveB=project_7.Geometry)  # -> Points, ParamsA, ParamsB
unit_z_13 = UnitZ(Factor=1)
point_3 = Point(flatten([curve_curve.Points, curve_curve_2.Points]))
project_point = ProjectPoint(Point=point_3, Direction=unit_z_13, Geometry=brep)  # -> Point, Index
deconstruct_6 = Deconstruct(Point=project_point.Point)  # -> XComponent, YComponent, ZComponent
integer = Integer(deconstruct_6.ZComponent)

# ---- group: rafters / dispatch
boolean = Boolean(smaller_than.SmallerThan)
plane_4 = Plane(horizontal_frame_2)
dispatch = Dispatch(List=plane_4, DispatchPattern=boolean)  # -> ListA, ListB
dispatch_2 = Dispatch(List=horizontal_frame, DispatchPattern=boolean)  # -> ListA, ListB
dispatch_3 = Dispatch(List=angle.Angle, DispatchPattern=boolean)  # -> ListA, ListB
dispatch_4 = Dispatch(List=ghpython_script_5, DispatchPattern=boolean)  # -> ListA, ListB
dispatch_5 = Dispatch(List=ghpython_script_4, DispatchPattern=boolean)  # -> ListA, ListB

# ---- group: sheathing roof
directshape_categories_2 = DirectShapeCategories("autodesk.revit.category.family:structuralFraming-1.0.0", SearchPattern="Structure")
component_family_form_2 = ComponentFamilyForm(Brep=extrude_3)
file_path_2 = FilePath("C:\ProgramData\Autodesk\RVT 2023\Family Templates\English\Metric Generic Model.rft")
new_component_family_2 = NewComponentFamily(
    Document={ModelURI="file:///D:/WORKS/2020/kkaa/work/revit/dune 1 bed.rvt", PathName="D:\WORKS\2020\kkaa\work\revit\dune 1 bed.rvt"},
    Template=file_path_2,
    Overwrite=Toggle(True),
    Name="Sheathing",
    Category=directshape_categories_2,
    Geometry=component_family_form_2)
family_types_2 = FamilyTypes(Family=new_component_family_2)
xy_plane_2 = XYPlane(Origin=Point(0, 0, 0))
add_component_location_4 = AddComponentLocation(Location=xy_plane_2, Type=family_types_2, Level=<geometry referenced from the Revit model>, TrackingMode=2)
element_parameter_4 = ElementParameter(Element=add_component_location_4, Parameter="Offset from Host", Value="0")  # -> Element, Parameter, Value

# ----
region_intersection = RegionIntersection(CurvesA=geometry_2, CurvesB=graft(offset_curve))
area_3 = Area(Geometry=region_intersection)  # -> Area, Centroid
mass_addition_3 = MassAddition(Input=flatten(area_3.Area))  # -> Result, PartialResults

# ---- group: insulation roof
directshape_categories_3 = DirectShapeCategories("autodesk.revit.category.family:structuralFraming-1.0.0", SearchPattern="Structure")
component_family_form_3 = ComponentFamilyForm(Brep=solid_intersection)
file_path_3 = FilePath("C:\ProgramData\Autodesk\RVT 2023\Family Templates\English\Metric Generic Model.rft")
new_component_family_3 = NewComponentFamily(
    Document={ModelURI="file:///D:/WORKS/2020/kkaa/work/revit/dune 1 bed.rvt", PathName="D:\WORKS\2020\kkaa\work\revit\dune 1 bed.rvt"},
    Template=file_path_3,
    Overwrite=Toggle(True),
    Name="Insulation roof",
    Category=directshape_categories_3,
    Geometry=component_family_form_3)
family_types_3 = FamilyTypes(Family=new_component_family_3)
xy_plane_3 = XYPlane(Origin=Point(0, 0, 0))
add_component_location_5 = AddComponentLocation(Location=xy_plane_3, Type=family_types_3, Level=<geometry referenced from the Revit model>, TrackingMode=2)
element_parameter_5 = ElementParameter(Element=add_component_location_5, Parameter="Formwork area", Value=mass_addition_3.Result)  # -> Element, Parameter, Value
element_parameter_6 = ElementParameter(Element=add_component_location_5, Parameter="Offset from Host", Value="0")  # -> Element, Parameter, Value

# ---- group: rafters / dimensions / outer rafters
height = Slider(300, range=0..1000)
depth_3 = Slider(250, range=0..1000)
plane_5 = Plane(dispatch.ListB)

# ---- group: rafters (continued)
plane_6 = Plane(dispatch.ListA)
plane_7 = Plane(dispatch_2.ListA)
angle_2 = Number(dispatch_3.ListA)
angle_3 = Number(dispatch_3.ListB)

# ----
element_parameter_7 = ElementParameter(Element=add_component_location_4, Parameter="Formwork area", Value=mass_addition.Result)  # -> Element, Parameter, Value

query_views_2 = QueryViews(ViewFamily=109, ViewName="Structural Plan", IsDependent=False, IsTemplate=False)
add_text = AddText(View=query_views_2, Point=flatten(project_point.Point), Content=integer, TrackingMode=2)

# ---- group: RUN!!! / upper rafters
location = Plane(plane_6)
thickness_2 = Number(thickness)
height_2 = Number(hieght)
length_4 = Number(dispatch_5.ListA)
depth_4 = Number(depth)
angle_4 = Number(angle_2)

# ---- group: RUN!!! / outer rafters
depth_5 = Number(depth_3)
height_3 = Number(height)
angle_5 = Number(angle_3)
location_2 = Plane(plane_5)
length_5 = Number(dispatch_5.ListB)

# ---- group: RUN!!! / lower rafters
location_3 = Plane(plane_7)
length_6 = Number(dispatch_4.ListA)
height_4 = Number(hieght_2)
depth_6 = Number(depth_2)

# ----
curve_28 = Curve(curve_26)
move_6 = Move(Geometry=curve_28, Motion=addition)  # -> Geometry, Transform

# ---- group: RUN!!!
data_dam = DataDam(
    DataA=location,
    DataB=length_4,
    DataC=thickness_2,
    DataD=height_2,
    DataE=depth_4,
    DataF=angle_4,
    DataG=location_3,
    DataH=length_6,
    DataI=height_4,
    DataJ=depth_6,
    DataK=location_2,
    DataL=angle_5,
    DataM=length_5,
    DataN=height_3,
    DataO=depth_5,
    BufferDelay=10000000,
    BufferMode=0)  # -> DataA, DataB, DataC, DataD, DataE, DataF, DataG, DataH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

# ----
unit_z_14 = UnitZ(Factor=Slider(65, range=0..100))
move_7 = Move(Geometry=move_6.Geometry, Motion=unit_z_14)  # -> Geometry, Transform

# ---- group: purlin
addcrv = GhPythonScript(iCrvs=move_6.Geometry)  # -> oCrvs; inputs iCrvs: list of Curve
# ---------- addcrv: Python ----------
import rhinoscriptsyntax as rs
import Rhino.Geometry as rg
import ghpythonlib.treehelpers as th


newCrvs = []
addedLst = iCrvs[:]


for i in range(len(addedLst)-1):
    tweenCrv = rg.Curve.CreateTweenCurves(addedLst[i], addedLst[i+1], 1)[0]
    iCrvs.append(tweenCrv)

oCrvs = iCrvs
# ---------- end addcrv ----------
horizontal_frame_3 = HorizontalFrame(Curve=reparameterize(addcrv), Parameter=0)
curve_29 = Curve(addcrv)
move_8 = Move(Geometry=horizontal_frame_3, Motion=unit_z_11)  # -> Geometry, Transform

# ---- group: make rafter / upper rafter
add_component_location_6 = AddComponentLocation(Location=data_dam.DataA, Type=query_types_3, Level=<geometry referenced from the Revit model>, TrackingMode=2)

# ---- group: make rafter / lower rafter
add_component_location_7 = AddComponentLocation(Location=data_dam.DataG, Type=query_types_4, Level=<geometry referenced from the Revit model>, TrackingMode=2)

# ---- group: outer rafter
add_component_location_8 = AddComponentLocation(Location=data_dam.DataK, Type=query_types_3, Level=<geometry referenced from the Revit model>, TrackingMode=2)

# ---- group: calculate params
horizontal_frame_4 = HorizontalFrame(Curve=reparameterize(curve_29), Parameter=0)
project_8 = Project(Geometry=curve_29, Plane=horizontal_frame_4)  # -> Geometry, Transform
end_points_6 = EndPoints(Curve=curve_29)  # -> Start, End
end_points_7 = EndPoints(Curve=project_8.Geometry)  # -> Start, End
vector_2pt_6 = Vector2Pt(PointA=end_points_7.Start, PointB=end_points_7.End, Unitize=True)  # -> Vector, Length
vector_2pt_7 = Vector2Pt(PointA=end_points_6.Start, PointB=end_points_6.End, Unitize=True)  # -> Vector, Length
curve_30 = Curve(project_8.Geometry)
angle_6 = Angle(VectorA=vector_2pt_6.Vector, VectorB=vector_2pt_7.Vector)  # -> Angle, Reflex
length_7 = Length(Curve=curve_30)

# ---- group: purlin
plane_8 = Plane(move_8.Geometry)
query_types_7 = QueryTypes(
    Document={ModelURI="file:///D:/WORKS/2020/kkaa/work/revit/dune 1 bed.rvt", PathName="D:\WORKS\2020\kkaa\work\revit\dune 1 bed.rvt"},
    Kind=3,
    FamilyName="rafter dune villa",
    TypeName="Purlin")
add_component_location_9 = AddComponentLocation(Location=plane_8, Type=query_types_7, Level=<geometry referenced from the Revit model>, TrackingMode=2)

# ----
query_materials = QueryMaterials()
match_text_7 = MatchText(Text=query_materials, Pattern="*Timber Structure*", Case=True)
cull_pattern_10 = CullPattern(List=query_materials, CullPattern=match_text_7)
merge_5 = Merge(Data1=add_component_location_6, Data2=add_component_location_7)
element_parameter_8 = ElementParameter(Element=merge_5, Parameter="Structural Material", Value=cull_pattern_10)  # -> Element, Parameter, Value

merge_6 = Merge(Data1=add_component_location_6, Data2=add_component_location_7, Data3=add_component_location_8)
list_length_2 = ListLength(List=merge_6)
element_parameter_9 = ElementParameter(Element=merge_6, Parameter="Quantity", Value=list_length_2)  # -> Element, Parameter, Value

number = Number(data_dam.DataE)
number_2 = Number(data_dam.DataC)
number_3 = Number(data_dam.DataF)
number_4 = Number(data_dam.DataD)
element_parameter_10 = ElementParameter(Element=add_component_location_6, Parameter="D", Value=number)  # -> Element, Parameter, Value
element_parameter_11 = ElementParameter(Element=add_component_location_6, Parameter="L", Value=data_dam.DataB)  # -> Element, Parameter, Value
element_parameter_12 = ElementParameter(Element=add_component_location_6, Parameter="T", Value=number_2)  # -> Element, Parameter, Value
element_parameter_13 = ElementParameter(Element=add_component_location_6, Parameter="H", Value=number_4)  # -> Element, Parameter, Value
element_parameter_14 = ElementParameter(Element=add_component_location_6, Parameter="A", Value=number_3)  # -> Element, Parameter, Value

number_5 = Number(data_dam.DataJ)
number_6 = Number(data_dam.DataF)
number_7 = Number(data_dam.DataI)
number_8 = Number(data_dam.DataH)
number_9 = Number(data_dam.DataC)
element_parameter_15 = ElementParameter(Element=add_component_location_7, Parameter="D", Value=number_5)  # -> Element, Parameter, Value
element_parameter_16 = ElementParameter(Element=add_component_location_7, Parameter="T", Value=number_9)  # -> Element, Parameter, Value
element_parameter_17 = ElementParameter(Element=add_component_location_7, Parameter="H", Value=number_7)  # -> Element, Parameter, Value
element_parameter_18 = ElementParameter(Element=add_component_location_7, Parameter="L", Value=number_8)  # -> Element, Parameter, Value
element_parameter_19 = ElementParameter(Element=add_component_location_7, Parameter="A", Value=number_6)  # -> Element, Parameter, Value

number_10 = Number(data_dam.DataL)
number_11 = Number(data_dam.DataN)
number_12 = Number(data_dam.DataM)
number_13 = Number(data_dam.DataO)
element_parameter_20 = ElementParameter(Element=add_component_location_8, Parameter="D", Value=number_13)  # -> Element, Parameter, Value
element_parameter_21 = ElementParameter(Element=add_component_location_8, Parameter="H", Value=number_11)  # -> Element, Parameter, Value
element_parameter_22 = ElementParameter(Element=add_component_location_8, Parameter="A", Value=number_10)  # -> Element, Parameter, Value
element_parameter_23 = ElementParameter(Element=add_component_location_8, Parameter="L", Value=number_12)  # -> Element, Parameter, Value

list_length_3 = ListLength(List=add_component_location_9)

element_parameter_24 = ElementParameter(Element=add_component_location_9, Parameter="Quantity", Value=list_length_3)  # -> Element, Parameter, Value

angle_7 = Number(angle_6.Angle)
number_14 = Number(number_slider_8)
number_15 = Number(Slider(60, range=0..100))
number_16 = Number(length_7)
number_17 = Number(number_slider_8)
element_parameter_25 = ElementParameter(Element=add_component_location_9, Parameter="D", Value=number_17)  # -> Element, Parameter, Value
element_parameter_26 = ElementParameter(Element=add_component_location_9, Parameter="H", Value=number_14)  # -> Element, Parameter, Value
element_parameter_27 = ElementParameter(Element=add_component_location_9, Parameter="T", Value=number_15)  # -> Element, Parameter, Value
element_parameter_28 = ElementParameter(Element=add_component_location_9, Parameter="A", Value=angle_7)  # -> Element, Parameter, Value
element_parameter_29 = ElementParameter(Element=add_component_location_9, Parameter="L", Value=number_16)  # -> Element, Parameter, Value

# ---- group: make walls
unit_z_15 = UnitZ(Factor=expr("-x", Slider(700, range=0..1000)))

project_9 = Project(Curve=curve_6, Brep=brep, Direction=Vector(0, 0, 1))

move_9 = Move(Geometry=project_9, Motion=unit_z_15)  # -> Geometry, Transform

merge_7 = Merge(Data1=graft(curve_6), Data2=move_9.Geometry)
end_points_8 = EndPoints(Curve=merge_7)  # -> Start, End
line_3 = Line(StartPoint=end_points_8.Start, EndPoint=end_points_8.End)
list_item_13 = ListItem(List=line_3, Index=0, Wrap=True)
flip_curve_3 = FlipCurve(Curve=line_3, Guide=list_item_13)  # -> Curve, Flag
loft_7 = Loft(
    Curves=flip_curve_3.Curve,
    Options={Adjust=False, Closed=False, LoftEnds=0, LoftSimp=0, LoftType=0, Rebuild=10, Refit=0.01})
discontinuity_3 = Discontinuity(Curve=loft_7, Level=1)  # -> Points, Parameters
polyline_3 = PolyLine(Vertices=discontinuity_3.Points, Closed=True)  # -> flatten(Polyline)

wall_location_line = WallLocationLine({"Wall Centerline": 0, "Core Centerline": 1, "Finish (Exterior Face)": 2, "Finish (Interior Face)": 3, "Core (Exterior Face)": 4, "Core (Interior Face)": 5}, selected="Wall Centerline")
wall_location_line_2 = WallLocationLine({"Wall Centerline": 0, "Core Centerline": 1, "Finish (Exterior Face)": 2, "Finish (Interior Face)": 3, "Core (Exterior Face)": 4, "Core (Interior Face)": 5}, selected="Wall Centerline")
wall_location_line_3 = WallLocationLine({"Wall Centerline": 0, "Core Centerline": 1, "Finish (Exterior Face)": 2, "Finish (Interior Face)": 3, "Core (Exterior Face)": 4, "Core (Interior Face)": 5}, selected="Finish (Exterior Face)")
exterior_wall_2 = Curve(polyline)
curtain_wall_2 = Curve(polyline_3)
interior_wall_2 = Curve(polyline_2)
exterior_wall_3 = Curve(cull_pattern_3)
add_wall_profile = AddWallProfile(
    Profile=graft(curtain_wall_2),
    Type=cull_pattern_6,
    Level=<geometry referenced from the Revit model>,
    LocationLine=wall_location_line,
    AllowJoins=Toggle(True),
    TrackingMode=2)
add_wall_profile_2 = AddWallProfile(
    Profile=graft(exterior_wall_2),
    Type=cull_pattern_4,
    Level=<geometry referenced from the Revit model>,
    LocationLine=wall_location_line_3,
    AllowJoins=Toggle(False),
    TrackingMode=2)
add_wall_profile_3 = AddWallProfile(
    Profile=graft(interior_wall_2),
    Type=cull_pattern_5,
    Level=<geometry referenced from the Revit model>,
    LocationLine=wall_location_line_2,
    AllowJoins=Toggle(False),
    TrackingMode=2)
add_wall_curve = AddWallCurve(
    Curve=exterior_wall_3,
    Type=cull_pattern_4,
    Level=<geometry referenced from the Revit model>,
    LocationLine=wall_location_line_3,
    AllowJoins=Toggle(True),
    TrackingMode=2)

# ---- group: long beam
end_points_9 = EndPoints(Curve=project_4)  # -> Start, End
explode_2 = Explode(Curve=project_3, Recursive=True)  # -> Segments, Vertices
brep_closest_point = BrepClosestPoint(Point=end_points_9.End, Brep=move.Geometry)  # -> Point, Normal, Distance
interpolate = Interpolate(Vertices=explode_2.Vertices, Degree=3, Periodic=False, KnotStyle=1)  # -> Curve, Length, Domain
unit_z_16 = UnitZ(Factor=expr("-x", number_slider))
amplitude = Amplitude(Vector=brep_closest_point.Normal, Amplitude=number_slider_2)
extrude_4 = Extrude(Base=interpolate.Curve, Direction=unit_z_16)
move_10 = Move(Geometry=end_points_9.End, Motion=amplitude)  # -> Geometry, Transform
move_11 = Move(Geometry=end_points_9.Start, Motion=unit_z_16)  # -> Geometry, Transform
line_4 = Line(StartPoint=move_11.Geometry, EndPoint=move_10.Geometry)
merge_8 = Merge(Data1=graft(line_4), Data2=graft(project_4))

loft_8 = Loft(Curves=merge_8, Options={Adjust=False, Closed=False, LoftEnds=0, LoftSimp=0, LoftType=0, Rebuild=10, Refit=0.01})

offset_surface = OffsetSurface(
    Surface=[extrude_4, loft_8],
    Distance=expr("x/2", number_slider_2),
    BothSides=expr("-x/2", number_slider_2),
    CreateSolid=True)
brep_join_4 = BrepJoin(Breps=flatten(offset_surface))  # -> Breps, Closed

# ---- group: long beam / pole plate beam
directshape_categories_4 = DirectShapeCategories("autodesk.revit.category.family:structuralFraming-1.0.0", SearchPattern="Structure")
component_family_form_4 = ComponentFamilyForm(Brep=brep_join_4.Breps)
file_path_4 = FilePath("C:\ProgramData\Autodesk\RVT 2023\Family Templates\English\Metric Generic Model.rft")
data_dam_2 = DataDam(DataDataA=component_family_form_4, BufferDelay=10000000, BufferMode=0)
new_component_family_4 = NewComponentFamily(
    Document={ModelURI="file:///D:/WORKS/2020/kkaa/work/revit/dune 1 bed.rvt", PathName="D:\WORKS\2020\kkaa\work\revit\dune 1 bed.rvt"},
    Template=file_path_4,
    Overwrite=Toggle(True),
    Name="pole plate beam",
    Category=directshape_categories_4,
    Geometry=data_dam_2)
xy_plane_4 = XYPlane(Origin=Point(0, 0, 0))
family_types_4 = FamilyTypes(Family=new_component_family_4)
list_length_4 = ListLength(List=component_family_form_4)
add_component_location_10 = AddComponentLocation(Location=xy_plane_4, Type=family_types_4, Level=<geometry referenced from the Revit model>, TrackingMode=2)
element_parameter_30 = ElementParameter(Element=add_component_location_10, Parameter="Offset from Host", Value="0")  # -> Element, Parameter, Value

# ----
element_parameter_31 = ElementParameter(Element=add_component_location_10, Parameter="Formwork area", Value=mass_addition_2.Result)  # -> Element, Parameter, Value
element_parameter_32 = ElementParameter(Element=add_component_location_10, Parameter="Quantity", Value=list_length_4)  # -> Element, Parameter, Value

# ---- group: shingle
curve_31 = Curve(move_7.Geometry)

addcrv_2 = GhPythonScript(iCrvs=curve_31)  # -> oCrvs; inputs iCrvs: list of Curve; same code as addcrv
sort_crvs_3 = GhPythonScript(iCrvs=addcrv_2)  # -> output; inputs iCrvs: list of Curve; same code as sort_crvs

python = GhPythonScript(iCrvs=sort_crvs_3, iLength=length_3, iAngle=rotate, iA=repetition, iExtend=extend)  # -> oSurfaces; inputs iCrvs: tree of Curve, iA: Int32
# ---------- python: Python ----------
import Rhino.Geometry as rg
import ghpythonlib.treehelpers as th
import rhinoscriptsyntax as rs
import math
import copy

def Chunk(lst, size, step) :
    lst = [lst[i : i + size] for i in range(0, len(lst) - 1, step)]
    return lst


def DivideCrv(curve, n) :
    """divide 1 curve to n points"""
    points = []
    for i in range(0, n + 1) :
        curve.Domain = rg.Interval(0.0, 1.0)
        point = curve.PointAt((1 / n) * i)
        points.append(point)
    return points


def ConnectCrvs(curves, n) :
    lines = []
    pointsA = DivideCrv(curves[0], n)
    pointsB = DivideCrv(curves[1], n)
    for i in range(len(pointsA)) :
        line = rg.LineCurve(pointsA[i], pointsB[i])
        lines.append(line)
    assert isinstance(lines, object)
    return lines


def DivideCrvByLength(curve, length, offset) :
    points = []
    dist = offset
    while dist < curve.GetLength() :
        point = curve.PointAtLength(dist)
        dist += length
        assert isinstance(point, object)
        points.append(point)
    points.append(curve.PointAtNormalizedLength(1))
    if offset != 0:
        points[-1] = curve.PointAtNormalizedLength(1)
        points.insert(0, curve.PointAtNormalizedLength(0) )
    return points


def Connect2Lines(curves, length, offset) :
    """divide to points base on shorter line and connect 2 lines"""

    points = []
    for curve in curves:
        points.append( DivideCrvByLength(curve, length, offset) )

    lines = []
    if len(points[0]) < len(points[1]):
        rangeList = len(points[0])
    else:
        rangeList = len(points[1])
    for i in range(rangeList) :
        line = rg.LineCurve(points[0][i], points[1][i])
        lines.append(line)

    return lines


def ConnectAllCrv(curves, length, n) :
    """divide to points base on shorter line and connect every pair lines"""
    parCrvList = Chunk(curves, 2, 1)  # partition list into lists of pair of curve
    lineList = []
    if n != 0:
        for i in range(len(parCrvList)) :
            if i % n == 0 :
                lines = Connect2Lines(parCrvList[i], length, 0)
                lineList.append(lines)
            else :
                lines = Connect2Lines(parCrvList[i], length, length * ((i % n) / n))
                lineList.append(lines)
    else:
        for i in range(len(parCrvList)) :
            lines = Connect2Lines(parCrvList[i], length, 0)
            lineList.append(lines)
    return lineList


def LoftLines(list) :
    # loft lines in a list
    surfaces = []
    for i in range(len(list) - 1) :
        brep = rg.Brep.CreateFromLoft([list[i], list[i + 1]], rg.Point3d.Unset, rg.Point3d.Unset,
                                                                        rg.LoftType.Normal, False)
        surface = brep[0].Surfaces[0]
        surfaces.append(surface)
    return surfaces



def ExtendLine(X, Y, length):
    XY = rg.Vector3d(Y-X)
    XY.Unitize()
    newY = Y + XY * length
    
    return newY

def ExtendSurface(surface, direction, length):
    """direction = [1,2,3,4]"""

    surface.SetDomain(0, rg.Interval(0.0, 1.0))
    surface.SetDomain(1, rg.Interval(0.0, 1.0))
    
    A = surface.PointAt(0, 0)
    B = surface.PointAt(1, 0)
    C = surface.PointAt(1, 1)
    D = surface.PointAt(0, 1)
    
    if direction == 1:
        B = ExtendLine(A, B, length)
        C = ExtendLine(D, C, length)
    elif direction == 2:
        A = ExtendLine(D, A, length)
        B = ExtendLine(C, B, length)
    elif direction == 3:
        D = ExtendLine(A, D, length)
        C = ExtendLine(B, C, length)
    else:
        A = ExtendLine(B, A, length)
        D = ExtendLine(C, D, length)
        
    newSurface = rg.NurbsSurface.CreateFromCorners(A, B, C, D)

    return newSurface

"""start"""


connectLines = th.tree_to_list(iCrvs)
connectLines10 = connectLines[0]
connectLines12 = connectLines[1]

seperatedLines10 = ConnectAllCrv(connectLines10, iLength, iA) 
seperatedLines12 = ConnectAllCrv(connectLines12, iLength, iA)
subLines = ConnectAllCrv(connectLines10, iLength, 0) + ConnectAllCrv(connectLines12, iLength, 0)


"""thatch roof"""

allSurfaces = []
allSurfaces10 = []
allSurfaces12 = []
for list in seperatedLines10 :
    srf = LoftLines(list)
    allSurfaces10.append(srf)
for list in seperatedLines12 :
    srf = LoftLines(list)
    allSurfaces12.append(srf)


# extend
extendSurfaces10 = []
extendSurfaces12 = []
for list in allSurfaces10 :
    newLst = []
    for i, surface in enumerate(list):
        newLst.append(ExtendSurface(surface, 1, iExtend * (len(list)+1 - i)))
    extendSurfaces10.append(newLst)

for list in allSurfaces12 :
    newLst = []
    for i, surface in enumerate(list):
        newLst.append(ExtendSurface(surface, 1, (iExtend*0.5) * (len(list)+1 - i)))
    extendSurfaces10.append(newLst)

allSurfaces.append(extendSurfaces10)
allSurfaces.append(extendSurfaces12)

originalSrf = copy.deepcopy(allSurfaces)


#reverse all surfaces to the same normal 
for i in range(len(allSurfaces)):
    for sublist in allSurfaces[i]:
        for i in range(0, len(sublist)) :
            surface = sublist[i]
            surface.SetDomain(0, rg.Interval(0.0, 1.0))
            surface.SetDomain(1, rg.Interval(0.0, 1.0))
            normal = surface.NormalAt(0.5, 0.5)
            angle = math.degrees( rg.Vector3d.Multiply(normal, rg.Vector3d(0,0,1))  )
            if angle < 0:
                surface.Reverse(1, True)

# transform
for i in range(len(allSurfaces)):
    for sublist in allSurfaces[i]:
        for i in range(0, len(sublist)) :
            surface = sublist[i]
            surface.SetDomain(0, rg.Interval(0.0, 1.0))
            surface.SetDomain(1, rg.Interval(0.0, 1.0))
            # rotate
            angle_rad = math.radians(iAngle)
            rotationAxis = rg.Vector3d(surface.PointAt(0, 0) - surface.PointAt(0, 1))
            rotationCenter = surface.PointAt(0, 0)
            rotation = rg.Transform.Rotation(angle_rad, rotationAxis, rotationCenter)
            surface.Transform(rotation)




"""output"""
oSurfaces = th.list_to_tree(allSurfaces)
# ---------- end python ----------
md_slider = MDSlider(SliderMode=0, slider_value=Point(0, 1, 0.5), x_domain=Domain(0, 1), y_domain=Domain(0, 1), z_domain=Domain(0, 1))
iso_curve = IsoCurve(Surface=reparameterize(python), UVPoint=md_slider)  # -> UIsocurve, VIsocurve
expression = Expression(x=length_3, a=rotate, Expression="x * tan(rad(a))")
unit_z_17 = UnitZ(Factor="35")
move_12 = Move(Geometry=iso_curve.VIsocurve, Motion=expr("-x", unit_z_17))  # -> Geometry, Transform
offset_surface_2 = OffsetSurface(Surface=python, Distance=number_slider_6, BothSides=0, CreateSolid=True)
unit_z_18 = UnitZ(Factor=expression)
curve_32 = Curve(move_12.Geometry)
geometry_3 = Geometry(offset_surface_2)
extrude_5 = Extrude(Base=curve_32, Direction=unit_z_18)
brep_join_5 = BrepJoin(Breps=flatten(geometry_3))  # -> Breps, Closed
offset_surface_3 = OffsetSurface(Surface=extrude_5, Distance=number_slider_5, BothSides=0, CreateSolid=True)

custom_preview = CustomPreview(
    Geometry=python,
    Material={diffuse=RGB(221, 160, 221), emission=RGB(66, 48, 66), shine=0.5, specular=RGB(255, 255, 255), transparency=0})

# ---- group: sub-purlin
directshape_categories_5 = DirectShapeCategories("autodesk.revit.category.family:structuralFraming-1.0.0", SearchPattern="Structure")
component_family_form_5 = ComponentFamilyForm(Brep=flatten(offset_surface_3))
file_path_5 = FilePath("C:\ProgramData\Autodesk\RVT 2023\Family Templates\English\Metric Generic Model.rft")
data_dam_3 = DataDam(DataDataA=component_family_form_5, BufferDelay=10000000, BufferMode=0)
new_component_family_5 = NewComponentFamily(
    Document={ModelURI="file:///D:/WORKS/2020/kkaa/work/revit/dune 1 bed.rvt", PathName="D:\WORKS\2020\kkaa\work\revit\dune 1 bed.rvt"},
    Template=file_path_5,
    Overwrite=Toggle(True),
    Name="Sub-purlin",
    Category=directshape_categories_5,
    Geometry=data_dam_3)
xy_plane_5 = XYPlane(Origin=Point(0, 0, 0))
family_types_5 = FamilyTypes(Family=new_component_family_5)
list_length_5 = ListLength(List=component_family_form_5)
add_component_location_11 = AddComponentLocation(Location=xy_plane_5, Type=family_types_5, Level=<geometry referenced from the Revit model>, TrackingMode=2)
element_parameter_33 = ElementParameter(Element=add_component_location_11, Parameter="Offset from Host", Value="0")  # -> Element, Parameter, Value

# ---- group: shingle
directshape_categories_6 = DirectShapeCategories("autodesk.revit.category.family:structuralFraming-1.0.0", SearchPattern="Structure")
component_family_form_6 = ComponentFamilyForm(Brep=brep_join_5.Breps)
file_path_6 = FilePath("C:\ProgramData\Autodesk\RVT 2023\Family Templates\English\Metric Generic Model.rft")
data_dam_4 = DataDam(DataA=component_family_form_6, BufferDelay=10000000, BufferMode=0)
new_component_family_6 = NewComponentFamily(
    Document={ModelURI="file:///D:/WORKS/2020/kkaa/work/revit/dune 1 bed.rvt", PathName="D:\WORKS\2020\kkaa\work\revit\dune 1 bed.rvt"},
    Template=file_path_6,
    Overwrite=Toggle(True),
    Name="Shingle",
    Category=directshape_categories_6,
    Geometry=data_dam_4)
xy_plane_6 = XYPlane(Origin=Point(0, 0, 0))
family_types_6 = FamilyTypes(Family=new_component_family_6)
list_length_6 = ListLength(List=component_family_form_6)
add_component_location_12 = AddComponentLocation(Location=xy_plane_6, Type=family_types_6, Level=<geometry referenced from the Revit model>, TrackingMode=2)
element_parameter_34 = ElementParameter(Element=add_component_location_12, Parameter="Offset from Host", Value="0")  # -> Element, Parameter, Value

# ----
element_parameter_35 = ElementParameter(Element=add_component_location_12, Parameter="Quantity", Value=list_length_6)  # -> Element, Parameter, Value

element_parameter_36 = ElementParameter(Element=add_component_location_11, Parameter="Quantity", Value=list_length_5)  # -> Element, Parameter, Value
